# Grasshopper definition webApi.gh (Grasshopper 1.0.7)
# plug-ins: BITS

# https://ifcjsonteam.azurewebsites.net/api/test
file_path = FilePath("C:\Users\Nirvik Saha\source\repos\BITS\bin\data\fullHouse.ifc")
# https://jsonplaceholder.typicode.com/todos
webifc2json = WebIfc2JSon(InputIFCFile=file_path, InputURL="https://yesno.wtf/api")  # -> OutputJsonFromTheIFCFile, Debug
panel = Panel(webifc2json.OutputJsonFromTheIFCFile)
panel_2 = Panel(webifc2json.Debug)
